% Simulink data dictionary DD_Mdl.sldd

BEMTPitchMax_deg = -30
BladeLength_m = 61.5
BladeMass_kg = 17740
BladePitchMax_deg = 0
BladePitchStart_deg = -85
BladePitchrateNorm_degpers = 3
BladePitchrateStop_degpers = 9
BladePrecone_deg = 2.5
BladeTwist_deg = [13.308 13.308 13.308 13.308 13.308 13.308 13.308 13.308 13.308 13.308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 0]
Cut_OffWindSpeed_mpers = 25
DownwashCorrection = 0.26
DownwashModelSwitch = 3
GeneratorEfficiency = 0.944
HubRadius_m = 1.5
Overhang_m = 5
RatedOmega_RPM = 12.1
RatedWindSpeed_mpers = 11.4
Shafttilt_deg = 5
TipSpeedLoss = 0
TowerDamOnperoff = 0
TowerDragCoefficient = 0.35
TowerRadius_m = 1.935
cperR = [0.054; 0.054; 0.056; 0.058; 0.06; 0.061; 0.063; 0.065; 0.067; 0.069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 0.017]
drperR = [0.024 0.003 0.016 0.016 0.016 0.016 0.016 0.016 0.016 0.016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 0.005]
g_mpers_2 = 9.81
mpermBl = [0.058 0.008 0.044 0.043 0.042 0.034 0.026 0.024 0.023 0.022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 0]
nBl = 3
nR = 49
rho_kgperm3 = 1.225
rperR = [0.024 0.027 0.043 0.059 0.075 0.09 0.106 0.122 0.138 0.154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 1]
DT_s = 0.008
Ce = [15620.12 0 0 0; 0 8.862799e+08 0 0; 0 0 6215000 -6215000; 0 0 -6215000 6215000]

Cq = [0 0 0 0 0 0 0 0 0 0 -0.0003689683 -0.0004456443 -0.000529562 -0.0006193048 -0.0007167984 -0.0008204031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
 0 0 0 0 0 0 0 0 0 0 -0.0002191047 -0.0002881241 -0.0003640463 -0.0004453577 -0.0005340855 -0.0006283384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
 0 0 0 0 0 0 0 0 0 0 -6.960052e-05 -0.0001305882 -0.0001988172 -0.0002715426 -0.0003515007 -0.0004362571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
 0 0 0 0 0 0 0 0 0 0 7.993106e-05 2.666861e-05 -3.369948e-05 -9.783951e-05 -0.0001694713 -0.0002442725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
 0 0 0 0 0 0 0 0 0 0 0.0002295636 0.0001836535 0.0001308442 7.518854e-05 1.198278e-05 -5.287265e-05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
 0 0 0 0 0 0 0 0 0 0 0.0003789876 0.0003404728 0.0002952748 0.0002476183 0.0001930665 0.0001374452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
 0 0 0 0 0 0 0 0 0 0 0.0005280324 0.0004969588 0.0004594626 0.0004199643 0.0003741015 0.0003276828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
 0 0 0 0 0 0 0 0 0 0 0.0006770616 0.0006531186 0.0006235255 0.0005920257 0.0005544575 0.0005178007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
 0 0 0 0 0 0 0 0 0 0 0.0008261403 0.0008089392 0.0007870203 0.0007635254 0.0007346015 0.0007073868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
 0 0 0 0 0 0 0 0 0 0 0.0009748458 0.0009647078 0.0009503947 0.0009342211 0.0009142434 0.000895794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 ]

Ct = [0 0 0 0 0 0 0 0 0 0 0.08413848 0.08769086 0.09138101 0.09529364 0.09934564 0.1036403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
 0 0 0 0 0 0 0 0 0 0 0.08414434 0.08768306 0.09136057 0.09525927 0.09928905 0.1035672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
 0 0 0 0 0 0 0 0 0 0 0.08414583 0.08767419 0.09133859 0.0952241 0.09923151 0.103494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
 0 0 0 0 0 0 0 0 0 0 0.08414593 0.08766223 0.09131564 0.09518473 0.09917184 0.10342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
 0 0 0 0 0 0 0 0 0 0 0.08414418 0.08764812 0.09128888 0.09514027 0.09910978 0.1033422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
 0 0 0 0 0 0 0 0 0 0 0.0841392 0.08763219 0.09126022 0.0950915 0.09904341 0.1032593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
 0 0 0 0 0 0 0 0 0 0 0.08413314 0.08761513 0.09122944 0.09504184 0.09897676 0.1031737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
 0 0 0 0 0 0 0 0 0 0 0.08412692 0.087596 0.09119755 0.09499043 0.09890603 0.1030865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
 0 0 0 0 0 0 0 0 0 0 0.08411906 0.08757288 0.09116118 0.09493504 0.09883447 0.1029954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
 0 0 0 0 0 0 0 0 0 0 0.08410718 0.08754979 0.0911235 0.09487581 0.09875973 0.1029031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 ]

DT = 0.008
Drivetrain = struct(Generator=struct(Efficiency=0.944, HSSInertia=534.116), Gearbox=struct(Ratio=97, Efficiency=1))
K = [1589935 0 0 0; 0 4.077958e+09 0 0; 0 0 867637000 -867637000; 0 0 -867637000 867637000]
M = [436865 3352860 0 0; 3352860 211230180 0 0; 0 0 40469423.444 0; 0 0 0 5025497.444]
Ng = 97
Q = [1 0 0; 63 0 0; 0 1 0; 0 0 -97]
lambdaCt = [0; 0.1; 0.2; 0.3; 0.4; 0.5; 0.6; 0.7; 0.8; 0.9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 14.9]
pitchCt = [-0.1396263; -0.1361357; -0.132645; -0.1291544; -0.1256637; -0.122173; -0.1186824; -0.1151917; -0.1117011; -0.1082104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 0.4363323]
rho = 1.225

wecs = struct(
  Ng=97,
  mh=56780,
  mb=17740,
  mn=240000,
  mtower=347460,
  mt=383645,
  H=87.6,
  Jrg=534.116,
  Jr=40469423.444,
  wnb=4.393831,
  wnt=2.035752,
  wntsw=1.960354,
  zetat=0.01,
  zetab=0.477465,
  Kt=1589935,
  Bt=15620.12,
  Ktsw=1474343,
  Btsw=15041.6,
  Kb=342484.1,
  Bb=74433.52,
  Ks=867637000,
  Bs=6215000,
  N=3,
  rb=63)