% Simulink data dictionary DD_MdlCtrl_qLPVMPC.sldd

DT = 0.008
Ng = 97
lambdaCt = [0; 0.1; 0.2; 0.3; 0.4; 0.5; 0.6; 0.7; 0.8; 0.9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 14.9]
mu_old = repmat(0, 160, 1)
pitchCt = [-0.1396263; -0.1361357; -0.132645; -0.1291544; -0.1256637; -0.122173; -0.1186824; -0.1151917; -0.1117011; -0.1082104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 0.4363323]

CqCt = [0 0 0 0 0 0 0 0 0 0 -0.0003689683 -0.0004456443 -0.000529562 -0.0006193048 -0.0007167984 -0.0008204031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
 0 0 0 0 0 0 0 0 0 0 -0.0002191047 -0.0002881241 -0.0003640463 -0.0004453577 -0.0005340855 -0.0006283384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
 0 0 0 0 0 0 0 0 0 0 -6.960052e-05 -0.0001305882 -0.0001988172 -0.0002715426 -0.0003515007 -0.0004362571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
 0 0 0 0 0 0 0 0 0 0 7.993106e-05 2.666861e-05 -3.369948e-05 -9.783951e-05 -0.0001694713 -0.0002442725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
 0 0 0 0 0 0 0 0 0 0 0.0002295636 0.0001836535 0.0001308442 7.518854e-05 1.198278e-05 -5.287265e-05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
 0 0 0 0 0 0 0 0 0 0 0.0003789876 0.0003404728 0.0002952748 0.0002476183 0.0001930665 0.0001374452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
 0 0 0 0 0 0 0 0 0 0 0.0005280324 0.0004969588 0.0004594626 0.0004199643 0.0003741015 0.0003276828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
 0 0 0 0 0 0 0 0 0 0 0.0006770616 0.0006531186 0.0006235255 0.0005920257 0.0005544575 0.0005178007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
 0 0 0 0 0 0 0 0 0 0 0.0008261403 0.0008089392 0.0007870203 0.0007635254 0.0007346015 0.0007073868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
 0 0 0 0 0 0 0 0 0 0 0.0009748458 0.0009647078 0.0009503947 0.0009342211 0.0009142434 0.000895794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 ]

etag = 0.944

Control = struct(
  ForeAft=struct(Gain=0, MaxPitchAmplitude=5),
  Pitch=struct(
    Fine=0.106,
    Min=-2,
    Max=90,
    Minrate=-13,
    Maxrate=13,
    Kp=-0.003,
    Scheduled=1,
    ScheduledPitchAngles=[0.0706; 0.1168; 0.1524; 0.183; 0.2116; 0.2385; 0.263; 0.286; 0.308; 0.3284; 0.3488; 0.3691; 0.3895; 0.4083],
    KpGS=[-0.0164; -0.0107; -0.0083; -0.0068; -0.0057; -0.0049; -0.0043; -0.0037; -0.0033; -0.0028; -0.0026; -0.0023; -0.002; -0.0017],
    KiGS=[-0.0027; -0.0027; -0.0026; -0.0025; -0.0024; -0.0024; -0.0024; -0.0023; -0.0023; -0.0023; -0.0023; -0.0023; -0.0023; -0.0023],
    Ki=-0.001,
    StartupPitch=45,
    StartupPitchRate=1,
    StartupSpeed=0.25,
    Notch_beta1=0,
    Notch_beta2=0,
    Notch_wn=0,
    Notch_beta1GS=repmat(0, 14, 1),
    Notch_beta2GS=repmat(0, 14, 1),
    Notch_wnGS=repmat(0, 14, 1),
    LowPassCutOffFreq=3,
    LowPassCutOffFreqGS=repmat(3, 14, 1),
    LowPassOrder=1,
    Notch2_beta1GS=repmat(0, 14, 1),
    Notch2_beta2GS=repmat(0, 14, 1),
    Notch2_wnGS=repmat(0, 14, 1),
    Notch2_beta1=0,
    Notch2_beta2=0,
    Notch2_wn=0),
  Torque=struct(
    Demanded=43529,
    Limit=47403,
    Slewrate=20000,
    OptGain=2.3323,
    SpeedA=670,
    SpeedB=871,
    SpeedC=1162,
    SpeedB2=1136,
    Min=200,
    LowPassCutOffFreq=3),
  Brake=struct(Deploytime=0.6, Torque=28116, Delay=1.5),
  WindSpeed=struct(Cutin=4, Cutout=25),
  DT=0.008)