% Simulink data dictionary DD_Mdl1.sldd

slBus1 = Simulink.Bus()
  wind_mpers: double
  GenSpd_radpers: double
  RotSpd_radpers: double
  ydotdot_mpers2: double
  xdotdot_mpers2: double
  zetadotdot_mpers2: double
  ThetaS_rad: double
  GenPwr_kW: double
  GenTq_Nm: double
  Pitch_rad: double

slBus2 = Simulink.Bus()
  RefBlPitch1: double
  RefBlPitch2: double
  RefBlPitch3: double
  RefGenTq: double

wecsBus = Simulink.Bus()  % Bus for Wind Energy Conversion System (WECS)
  N: double
  Ng: double
  mh: double
  mbl: double
  mb: double
  mn: double
  mtower: double
  mr: double
  mt: double
  mtb: double
  H: double
  Jg: double
  Jr: double
  JrL: double
  Js: double
  wnb: double
  wnt: double
  wntsw: double
  zetat: double
  zetab: double
  Kt: double
  Bt: double
  Ktsw: double
  Btsw: double
  Kb: double
  Bb: double
  Ks: double
  Bs: double
  Rr: double
  rb: double
  etag: double

beta = [0; 0.001745329; 0.003490659; 0.005235988; 0.006981317; 0.008726646; 0.01047198; 0.0122173; 0.01396263; 0.01570796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 0.4363323]

Ce = [17786.98 0 0 0 0
 0 1246331 0 0 0
 0 0 17128.2 0 0
 0 0 0 6215000 -6215000
 0 0 0 -6215000 6215000]

Cq = [0 0 0 0 0 0 0 0 0 0 0.005169553 0.005334962 0.005512215 0.00570015 0.005915822 0.00624058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
 0 0 0 0 0 0 0 0 0 0 0.005235708 0.005403338 0.005583095 0.005773848 0.005994796 0.006330977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
 0 0 0 0 0 0 0 0 0 0 0.005301551 0.005471704 0.005653659 0.005847554 0.006073442 0.006421039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
 0 0 0 0 0 0 0 0 0 0 0.005367145 0.00553964 0.005724164 0.005921267 0.006152344 0.006511206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
 0 0 0 0 0 0 0 0 0 0 0.005432696 0.005607475 0.005794674 0.005994989 0.006231804 0.006601317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
 0 0 0 0 0 0 0 0 0 0 0.005498167 0.005675071 0.005865191 0.006068381 0.00631166 0.006691262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
 0 0 0 0 0 0 0 0 0 0 0.005563647 0.005742617 0.005935634 0.006141507 0.006391803 0.006781691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
 0 0 0 0 0 0 0 0 0 0 0.005629093 0.005810584 0.00600582 0.006214694 0.006471612 0.006874165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
 0 0 0 0 0 0 0 0 0 0 0.005694543 0.005878148 0.006075933 0.006288041 0.006552229 0.006966884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
 0 0 0 0 0 0 0 0 0 0 0.005759826 0.00594572 0.006145822 0.006361012 0.006632709 0.007060015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 ]

Ct = [0 0 0 0 0 0 0 0 0 0 0.08296217 0.0859444 0.08898923 0.09218252 0.09547205 0.099147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
 0 0 0 0 0 0 0 0 0 0 0.08292507 0.0858965 0.08893239 0.09211563 0.09539839 0.09907465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
 0 0 0 0 0 0 0 0 0 0 0.08288701 0.08584788 0.08887387 0.09204868 0.09532177 0.09900196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
 0 0 0 0 0 0 0 0 0 0 0.08284852 0.08579822 0.08881448 0.09198163 0.09528317 0.09892982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
 0 0 0 0 0 0 0 0 0 0 0.08280999 0.0857479 0.08875488 0.09191438 0.09520931 0.0988561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
 0 0 0 0 0 0 0 0 0 0 0.08277126 0.08569671 0.08869521 0.09184644 0.09515612 0.09878253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
 0 0 0 0 0 0 0 0 0 0 0.08273247 0.08564468 0.08863495 0.0917777 0.09508159 0.09871075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
 0 0 0 0 0 0 0 0 0 0 0.08269272 0.0855223 0.08857483 0.09170892 0.09500664 0.09866092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
 0 0 0 0 0 0 0 0 0 0 0.08265194 0.08547015 0.08851378 0.09163989 0.09495906 0.09859092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
 0 0 0 0 0 0 0 0 0 0 0.08260986 0.08541792 0.08845225 0.09156891 0.09488377 0.09852131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 ]

K5 = [1810494 0 0 0 -0
 0 5.734629e+08 0 0 -0
 0 0 1678867 0 -0
 0 0 0 867637000 -867637000
 0 0 0 -867637000 867637000]

lambda = [0; 0.1; 0.2; 0.3; 0.4; 0.5; 0.6; 0.7; 0.8; 0.9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 19.9]

M = [450170 628661.25 0 0 0
 628661.25 29704244.0625 0 0 0
 0 0 436865 0 0
 0 0 0 35443926 0
 0 0 0 0 5025497.444]

Q = [1 0 0; 47.25 0 0; 0 0.007407407 -0.7185185; 0 1 0; 0 0 -97]
rho = 1.225

wecs = struct(
  N=3,
  Ng=97,
  mh=56780,
  mbl=17740,
  mb=4435,
  mn=240000,
  mtower=347460,
  mr=110000,
  mt=436865,
  mtb=450170,
  H=90,
  Jg=534.116,
  Jr=38759000,
  JrL=35443926,
  Js=43784497.444,
  wnb=4.393831,
  wnt=2.035752,
  wntsw=1.960354,
  zetat=0.01,
  zetab=0.00477465,
  Kt=1810494,
  Bt=17786.98,
  Ktsw=1678867,
  Btsw=17128.2,
  Kb=85621.02,
  Bb=186.0838,
  Ks=867637000,
  Bs=6215000,
  Rr=63,
  rb=47.25,
  etag=0.944)

Lin_points = struct(
  V=[4.000002 5.000001 6.000002 7.000001 8.000001 9 10 11 12 13 14 15 16 17 18 19 20 21 22 23 24 25],
  RSpeed=[0.7481165 0.7812295 0.8258681 0.880428 0.9456415 1.062313 1.178091 1.240277 1.254474 1.254476 1.254478 1.254478 1.254478 1.254478 1.254478 1.254478 1.254478 1.254478 1.254478 1.254478 1.254479 1.254479],
  Pitch=[0.001850049 0.001850049 0.001850049 0.001850049 0.001850049 0.001850049 0.001850049 0.001850049 0.04987196 0.1038412 0.1426653 0.1754282 0.2046965 0.231624 0.2566137 0.280043 0.3023087 0.3237978 0.3446505 0.3648433 0.3843441 0.4032162],
  Torque=[2.393646 5.324649 9.275124 14.10328 19.62374 24.76464 30.45676 38.20573 43.529 43.529 43.529 43.529 43.529 43.529 43.529 43.529 43.529 43.529 43.529 43.529 43.529 43.529])