% Simulink data dictionary DD_test.sldd

DT = 0.008

Lin_points2 = struct(
  V=[4; 5; 6; 7; 8; 9; 10; 11; 12; 13; 14; 15; 16; 17; 18; 19; 20; 21; 22],
  Torque=[2.206823; 4.998409; 8.821002; 13.51231; 18.96609; 23.85775; 29.47533; 37.02019; 43.529; 43.529; 43.529; 43.529; 43.529; 43.529; 43.529; 43.529; 43.529; 43.529; 43.529],
  Pitch=[0 0 0 0 0 0 0 0 0.06419321 0.1125912 0.1492955 0.1808161 0.209265 0.2356194 0.2602286 0.2832669 0.3054326 0.3269002 0.3476696],
  GSpeed=[72.35067; 75.42695; 79.61105; 84.75772; 90.7328; 101.1654; 112.441; 119.9989; 121.7784; 121.7142; 121.6893; 121.6979; 121.6901; 121.6963; 121.6899; 121.6858; 121.6904; 121.6855; 121.6847],
  RSpeed=[0.7458832; 0.7775974; 0.8207325; 0.8737909; 0.9353897; 1.042942; 1.159185; 1.237102; 1.255448; 1.254786; 1.254529; 1.254618; 1.254538; 1.254601; 1.254535; 1.254493; 1.25454; 1.25449; 1.254482],
  x_op={[0.04131; 0.0069; -0.0001995; 0.0001116; 2.877; 0.0005694; 0.7803; 0.963; 1.157; 0.4647; -0.08951; -0.2865; 0.003217; -0.01644; -0.02969; -2.198e-5; 0.003537; -4.211e-7; 3.26e-6; 0.4815; 1.787e-6; -0.05486; 0.1072; -0.05207; 0.05682; -0.2113; 0.1543; 0.003721; -0.009198; 0.005475], [0.07334; 0.008976; -0.0001339; 0.0001724; 1.242; 0.0008886; 1.562; 1.213; 1.521; -0.1014; 0.4842; -0.2589; -0.02869; -0.0005194; -0.03006; 5.968e-5; 0.004033; 7.658e-7; 3.666e-6; 0.6017; 1.77e-6; -0.1076; -0.01628; 0.123; 0.2565; -0.05234; -0.2044; 0.01028; -0.0004523; -0.009816], [0.1125; 0.01134; -5.271e-5; 0.0002463; 0.01409; 0.001278; 2.191; 1.94; 1.813; -0.3964; 0.286; 0.2756; -0.04587; -0.01958; -0.01463; 0.000354; 0.003978; 2.567e-7; 3.976e-6; 0.7217; 1.459e-6; 0.05373; -0.1576; 0.1023; 0.007863; 0.279; -0.2871; -0.002074; 0.01306; -0.01099], [0.1587; 0.01397; 3.739e-5; 0.0003332; 5.199; 0.001736; 2.62; 2.792; 2.408; -0.1422; -0.1684; 0.5222; -0.04131; -0.04833; -0.01609; -7.696e-5; 0.002736; -7.288e-7; 1.906e-6; 0.8413; 7.965e-7; 0.1875; -0.1036; -0.08092; -0.3383; 0.3212; 0.0171; -0.01568; 0.01226; 0.003392], [0.211; 0.01821; 0.0001457; 0.0004334; 4.106; 0.002261; 3.097; 3.474; 3.309; 0.3478; -0.364; 0.2778; -0.03148; -0.06454; -0.0404; -4.695e-5; -0.001331; 3.646e-6; -1.011e-6; 0.9603; -1.677e-6; 0.08895; 0.1207; -0.214; -0.3575; -0.03384; 0.3913; -0.01333; -0.004979; 0.0184], [0.2698; 0.02646; 0.000259; 0.0005498; 2.939; 0.002853; 3.882; 3.961; 4.244; 0.5476; -0.0382; -0.1956; -0.03895; -0.06004; -0.07344; 0.0002492; -0.005957; -6.89e-6; -6.088e-6; 1.078; -2.594e-6; -0.1679; 0.2179; -0.04473; 0.1036; -0.4659; 0.3628; 0.008205; -0.02128; 0.01306], [0.334; 0.03532; 0.000387; 0.0006769; 1.607; 0.003507; 4.95; 4.592; 4.861; 0.1364; 0.5101; -0.2794; -0.07471; -0.05235; -0.08691; -0.0002663; -0.00161; 1.117e-5; -1.748e-6; 1.195; 3.238e-7; -0.1954; -0.05049; 0.2446; 0.5376; -0.2843; -0.2531; 0.02413; -0.008685; -0.01559], [0.3956; 0.04239; 0.0005191; 0.0008446; 6.234; 0.004372; 5.623; 5.576; 5.281; -0.3273; 0.3278; 0.3767; -0.1053; -0.07984; -0.07086; -0.0004511; -0.004996; 9.319e-6; 2.864e-6; 1.267; -0.0001925; 0.2239; -0.2734; 0.03724; -0.03051; 0.5082; -0.4833; -0.006785; 0.02542; -0.01891], [0.3341; 0.04564; 0.0004002; 0.0009247; 0.03745; 0.004794; 4.769; 4.535; 4.324; -0.2975; 0.3902; 0.3606; -0.1037; -0.07077; -0.06565; -0.0001543; -0.003804; 6.322e-6; -4.17e-6; 1.267; 7.019e-5; 0.15; -0.3282; 0.1772; 0.02945; 0.4777; -0.5066; -0.003579; 0.02777; -0.02422], [0.2859; 0.04669; 0.0003027; 0.0009276; 0.04602; 0.004823; 4.053; 3.745; 3.563; -0.2841; 0.4024; 0.3601; -0.1014; -0.06454; -0.06058; 2.558e-5; -0.00451; 7.431e-6; 7.383e-5; 1.267; 0.0001253; 0.1301; -0.3542; 0.239; 0.02541; 0.4547; -0.5177; -0.00404; 0.02835; -0.02873], [0.2553; 0.04794; 0.0002407; 0.0009237; 0.04362; 0.004787; 3.557; 3.211; 3.04; -0.2781; 0.403; 0.3589; -0.101; -0.0615; -0.05805; 0.0002174; -0.003918; 3.983e-7; -5.044e-5; 1.268; -0.0003327; 0.114; -0.3819; 0.2602; 0.04609; 0.4675; -0.4962; -0.001135; 0.033; -0.028], [0.2328; 0.04771; 0.0001945; 0.0009218; 0.03723; 0.004792; 3.157; 2.792; 2.623; -0.2774; 0.3969; 0.3555; -0.1015; -0.06024; -0.05689; 0.0001957; -0.003255; 7.142e-6; 3.87e-6; 1.268; -0.0002483; 0.1135; -0.3894; 0.2785; 0.03644; 0.4572; -0.4976; -0.002376; 0.03275; -0.03073], [0.2151; 0.04768; 0.0001593; 0.0009185; 0.03189; 0.004779; 2.818; 2.438; 2.272; -0.2782; 0.3896; 0.3506; -0.1025; -0.05975; -0.05646; 0.000359; -0.003616; 1.113e-5; 1.438e-6; 1.267; 0.0002154; 0.1098; -0.3965; 0.2898; 0.03604; 0.4551; -0.4911; -0.001923; 0.03408; -0.03136], [0.2007; 0.04739; 0.0001317; 0.0009133; 0.02975; 0.004763; 2.513; 2.132; 1.971; -0.2804; 0.3824; 0.3438; -0.104; -0.0598; -0.05677; 0.0003789; -0.0036; 1.436e-5; -5.774e-6; 1.267; 0.0001856; 0.1087; -0.3982; 0.2954; 0.03509; 0.4506; -0.4879; -0.001506; 0.035; -0.0324], [0.1886; 0.0469; 0.000109; 0.0009056; 0.02615; 0.004736; 2.222; 1.856; 1.698; -0.2836; 0.3741; 0.3371; -0.1059; -0.06046; -0.05768; 0.000544; -0.003864; 1.702e-5; -2.398e-5; 1.267; -0.0002259; 0.1022; -0.3877; 0.286; 0.0361; 0.4499; -0.4818; -0.001857; 0.03554; -0.03365], [0.1787; 0.04624; 9.25e-5; 0.0009014; 0.0231; 0.004712; 1.964; 1.601; 1.451; -0.2877; 0.3645; 0.3294; -0.1077; -0.06181; -0.05909; 0.0008378; -0.004948; 1.187e-5; -1.719e-5; 1.267; 7.566e-5; 0.09429; -0.3697; 0.2789; 0.03389; 0.4465; -0.4776; -0.001482; 0.03673; -0.03375], [0.1705; 0.04558; 7.926e-5; 0.000893; 0.02052; 0.004681; 1.738; 1.366; 1.226; -0.2905; 0.356; 0.3225; -0.1092; -0.06326; -0.06051; 0.001178; -0.005734; 1.022e-5; -5.116e-6; 1.267; -0.0001788; 0.08555; -0.3642; 0.2793; 0.03194; 0.4429; -0.474; -0.002084; 0.03637; -0.03451], [0.1635; 0.0447; 6.88e-5; 0.0008854; 0.01793; 0.004654; 1.525; 1.155; 1.024; -0.2944; 0.3466; 0.315; -0.1109; -0.06464; -0.06185; 0.001171; -0.005888; 1.703e-5; 6.773e-6; 1.267; -1.033e-5; 0.07653; -0.3624; 0.2823; 0.03287; 0.4418; -0.466; -0.001506; 0.03663; -0.03475], [0.1572; 0.04437; 6.125e-5; 0.0008803; 0.01484; 0.004635; 1.307; 0.9616; 0.8413; -0.2997; 0.337; 0.3075; -0.1132; -0.06609; -0.06345; 0.001236; -0.006319; 2.168e-5; 1.129e-5; 1.267; -0.0001963; 0.06678; -0.3408; 0.2792; 0.02768; 0.4363; -0.4656; -0.001538; 0.03678; -0.03546], [0.152; 0.04358; 5.725e-5; 0.000871; 0.0115; 0.004598; 1.089; 0.7739; 0.6698; -0.3056; 0.3271; 0.3004; -0.1157; -0.06802; -0.06556; 0.001352; -0.006508; 2.524e-5; -4.907e-6; 1.267; 0.000107; 0.04932; -0.3041; 0.2608; 0.02479; 0.4345; -0.4622; -0.001169; 0.03747; -0.03551], [0.1473; 0.04297; 5.618e-5; 0.0008616; 0.009086; 0.004567; 0.8786; 0.5881; 0.5067; -0.3123; 0.3165; 0.2923; -0.1182; -0.07041; -0.06808; 0.001499; -0.006749; 2.975e-5; 2.093e-5; 1.267; -0.0002316; 0.03511; -0.2624; 0.2409; 0.02029; 0.4315; -0.4612; -0.001698; 0.03683; -0.03665], [0.1431; 0.0426; 5.567e-5; 0.0008521; 0.0076; 0.004524; 0.6794; 0.4069; 0.3492; -0.3188; 0.3064; 0.2837; -0.1204; -0.0729; -0.07073; 0.001364; -0.005829; 2.768e-5; -1.519e-5; 1.267; 6.889e-5; 0.02011; -0.2305; 0.2204; 0.02097; 0.432; -0.4578; -0.001578; 0.03684; -0.03662]},
  y_op={[4; 0; 0; 224.3; 5.087; 0.8554; 0.9236; 1.07; 0.3639; -0.2084; -0.4287; 0.0001556; 0.006959; 2.183e-5; 1775; 1575; 1864; -3300; 1075; 2697; 1775; 1575; 1864; -3300; 1075; 2697; 739.6; 7383; -30.99; 120.2; -496.1; 4.598; 446; 0; 254.9; 237.9; 191.1; 4.598; 5.093], [5; 0; 0; 437.7; 7.945; 1.503; 1.284; 1.434; -0.2951; 0.3298; -0.4458; 0.0006229; 0.003456; 9.131e-5; 2700; 2480; 2391; 1410; -3282; 2609; 2700; 2480; 2391; 1410; -3282; 2609; 866.6; 12350; -58.93; 499.7; 157.7; 5.746; 557.3; 0; 161.2; 463.9; 245.8; 5.746; 7.949], [6; 0; 0; 755.4; 11.43; 2.06; 1.953; 1.83; -0.6658; 0.04247; 0.04853; 0.0009319; -0.001303; 0.0001337; 3476; 3632; 3286; 3949; -1467; -1422; 3476; 3632; 3286; 3949; -1467; -1422; 995.2; 18420; -91.81; 19.13; 535.1; 6.892; 668.5; 0; 90.88; 800.1; 312.5; 6.892; 11.43], [7; 0; 0; 1197; 15.53; 2.533; 2.692; 2.461; -0.4666; -0.5144; 0.219; -0.0008483; -0.007987; -0.0001125; 4350; 4748; 4558; 2144; 2412; -3117; 4350; 4748; 4558; 2144; 2412; -3117; 1119; 25610; -137.3; -507.2; 272.1; 8.034; 779.3; 0; 27.96; 1267; 391.3; 8.034; 15.53], [8; 0; 0; 1779; 20.24; 3.099; 3.319; 3.288; -0.0396; -0.7932; -0.1359; 0.000682; -0.01004; 8.155e-5; 5566; 5731; 5999; -1469; 4214; -870.7; 5566; 5731; 5999; -1469; 4214; -870.7; 1459; 33710; -208.1; -475.5; -359.5; 9.17; 889.5; 0; 325.4; 1884; 480.8; 9.17; 20.23], [9; 0; 0; 2520; 25.52; 3.904; 3.862; 4.102; 0.0606; -0.5304; -0.7224; -0.0006126; 0.001331; -6.727e-5; 7175; 6800; 7296; -2734; 1889; 3209; 7175; 6800; 7296; -2734; 1889; 3209; 2398; 42850; -268.7; 170.3; -633.9; 10.3; 998.9; 0; 258.6; 2670; 581.1; 10.3; 25.52], [10; 0; 0; 3432; 31.35; 4.857; 4.588; 4.686; -0.4811; -0.065; -0.8824; 0.0001878; 0.01364; 4.761e-5; 8849; 8386; 8293; 891.7; -2128; 4139; 8849; 8386; 8293; 891.7; -2128; 4139; 3405; 52830; -385.7; 708.2; 79.63; 11.41; 1107; 0; 182.3; 3637; 691.3; 11.41; 31.37], [11; 0; 0; 5000; 43.09; 5.415; 5.505; 5.229; -1.026; -0.3694; -0.2836; 0.001024; 0.009517; 0.000152; 9707; 10140; 9542; 4805; -375.1; -811.6; 9707; 10140; 9542; 4805; -375.1; -811.6; 3969; 62360; -464.8; -150.3; 701.6; 12.1; 1174; 0; 87.44; 4804; 796; 12.1; 39.09], [12; 0; 0; 5001; 43.09; 4.508; 4.471; 4.262; -1.183; -0.4671; -0.4564; 0.0005214; 0.004994; 8.721e-5; 8263; 8629; 8110; 4933; -557.1; -407.1; 8563; 8576; 8067; 4393; -1109; -926.5; 4223; 52800; -510; -106.2; 647.6; 12.1; 1174; 3.678; 92.42; 5272; 690.3; 12.1; 42.89], [13; 0; 0; 5000; 43.09; 3.755; 3.684; 3.5; -1.22; -0.4869; -0.4851; 0.0003445; 0.006549; 1.335e-5; 7064; 7472; 6989; 4929; -585.1; -357.3; 7573; 7359; 6904; 4104; -1421; -1140; 4386; 45310; -574; -166.3; 627.4; 12.1; 1174; 6.451; 92.91; 5304; 607.8; 12.1; 43.14], [14; 0; 0; 5002; 43.09; 3.232; 3.154; 2.978; -1.219; -0.4781; -0.474; 0.001155; 0.01489; 7.336e-5; 6254; 6719; 6253; 4903; -590.4; -363.3; 6914; 6557; 6129; 3918; -1583; -1289; 4597; 40560; -633.7; -234.3; 620.1; 12.1; 1174; 8.554; 92.77; 5260; 555.8; 12.1; 42.79], [15; 0; 0; 5002; 43.09; 2.81; 2.736; 2.564; -1.2; -0.4579; -0.4465; 0.001505; 0.01295; 0.000192; 5612; 6145; 5690; 4887; -564.8; -373.8; 6400; 5943; 5530; 3798; -1661; -1391; 4569; 37070; -706; -311.3; 615.5; 12.1; 1174; 10.36; 92.41; 5267; 517.4; 12.1; 42.85], [16; 0; 0; 5000; 43.09; 2.453; 2.385; 2.217; -1.17; -0.427; -0.4097; 0.001572; 0.01207; 0.0001963; 5077; 5675; 5231; 4862; -545.4; -383.8; 5976; 5438; 5038; 3701; -1712; -1462; 4579; 34320; -777; -386.8; 609.3; 12.1; 1174; 11.99; 92.1; 5257; 487.1; 12.1; 42.76], [17; 0; 0; 5000; 43.09; 2.133; 2.083; 1.921; -1.129; -0.389; -0.3685; 0.002228; 0.01126; 0.0003237; 4608; 5283; 4850; 4831; -534.5; -383.8; 5608; 5013; 4627; 3622; -1753; -1505; 4550; 32090; -859.3; -472.9; 602.9; 12.1; 1174; 13.5; 91.98; 5239; 462.6; 12.1; 42.62], [18; 0; 0; 5001; 43.09; 1.832; 1.813; 1.654; -1.075; -0.3449; -0.3198; 0.002691; 0.01138; 0.0004264; 4174; 4942; 4520; 4789; -520.9; -389.7; 5266; 4641; 4268; 3554; -1775; -1540; 4494; 30200; -955.1; -575.4; 594.8; 12.1; 1174; 14.91; 91.77; 5205; 441.6; 12.1; 42.34], [19; 0; 0; 5000; 43.09; 1.565; 1.565; 1.414; -1.019; -0.2945; -0.2671; 0.002007; 0.009195; 0.0002415; 3791; 4636; 4232; 4749; -505.8; -390.7; 4968; 4310; 3954; 3500; -1782; -1558; 4400; 28660; -1041; -665.1; 581.2; 12.1; 1174; 16.23; 91.59; 5182; 424.2; 12.1; 42.15], [20; 0; 0; 5001; 43.09; 1.334; 1.338; 1.199; -0.9616; -0.2387; -0.2111; 0.001888; 0.008514; 0.0002674; 3459; 4365; 3979; 4707; -497.4; -393.6; 4714; 4013; 3677; 3449; -1787; -1572; 4318; 27360; -1108; -738.2; 565.7; 12.1; 1174; 17.5; 91.44; 5146; 409.6; 12.1; 41.86], [21; 0; 0; 5001; 43.09; 1.117; 1.137; 1.007; -0.9004; -0.1837; -0.1555; 0.001338; 0.004929; 0.0001912; 3148; 4124; 3756; 4662; -483.8; -393.2; 4478; 3750; 3431; 3404; -1782; -1579; 4205; 26260; -1187; -820.7; 550.6; 12.1; 1174; 18.73; 91.29; 5117; 396.9; 12.1; 41.62], [22; 0; 0; 5001; 43.09; 0.8993; 0.9544; 0.8353; -0.829; -0.1279; -0.09956; 0.0008973; 0.005723; 7.359e-5; 2840; 3907; 3561; 4612; -466.1; -387.4; 4241; 3514; 3216; 3369; -1769; -1577; 4165; 25280; -1288; -926.8; 531.5; 12.1; 1174; 19.92; 91.12; 5095; 385.6; 12.1; 41.45], [23; 0; 0; 5000; 43.09; 0.684; 0.7789; 0.6759; -0.7483; -0.0666; -0.0412; 0.0005319; 0.00288; 7.485e-5; 2542; 3704; 3390; 4553; -451.4; -381.5; 4008; 3295; 3027; 3335; -1752; -1574; 4071; 24440; -1400; -1043; 502.6; 12.1; 1174; 21.06; 90.92; 5056; 375.6; 12.1; 41.13], [24; 0; 0; 5001; 43.09; 0.48; 0.6072; 0.5257; -0.6641; 0.0006126; 0.01903; 0.0002271; 0.002232; 4.058e-5; 2258; 3510; 3234; 4491; -439.9; -369.2; 3785; 3085; 2855; 3308; -1732; -1562; 4002; 23700; -1506; -1156; 468.2; 12.1; 1174; 22.16; 90.78; 5020; 366.7; 12.1; 40.84], [25; 0; 0; 5000; 43.09; 0.2897; 0.4425; 0.3825; -0.5775; 0.07271; 0.0821; 0.000399; 0.00228; 0.000143; 1989; 3326; 3085; 4426; -434.5; -354.5; 3573; 2884; 2695; 3283; -1711; -1543; 3975; 23010; -1607; -1262; 435; 12.1; 1174; 23.24; 90.69; 4975; 358.4; 12.1; 40.47]},
  u_op={[4; 0; 0; 0; 0; 0; 0; 5087; 0], [5; 0; 0; 0; 0; 0; 0; 7945; 0], [6; 0; 0; 0; 0; 0; 0; 11430; 0], [7; 0; 0; 0; 0; 0; 0; 15530; 0], [8; 0; 0; 0; 0; 0; 0; 20240; 0], [9; 0; 0; 0; 0; 0; 0; 25520; 0], [10; 0; 0; 0; 0; 0; 0; 31350; 0], [11; 0; 0; 0; 0; 0; 0; 43090; 0], [12; 0; 0; 0.06419; 0.06419; 0.06419; 0; 43090; 0.06419], [13; 0; 0; 0.1126; 0.1126; 0.1126; 0; 43090; 0.1126], [14; 0; 0; 0.1493; 0.1493; 0.1493; 0; 43090; 0.1493], [15; 0; 0; 0.1808; 0.1808; 0.1808; 0; 43090; 0.1808], [16; 0; 0; 0.2093; 0.2093; 0.2093; 0; 43090; 0.2093], [17; 0; 0; 0.2356; 0.2356; 0.2356; 0; 43090; 0.2356], [18; 0; 0; 0.2602; 0.2602; 0.2602; 0; 43090; 0.2602], [19; 0; 0; 0.2833; 0.2833; 0.2833; 0; 43090; 0.2833], [20; 0; 0; 0.3055; 0.3055; 0.3055; 0; 43090; 0.3055], [21; 0; 0; 0.3269; 0.3269; 0.3269; 0; 43090; 0.3269], [22; 0; 0; 0.3476; 0.3476; 0.3476; 0; 43090; 0.3476], [23; 0; 0; 0.3676; 0.3676; 0.3676; 0; 43090; 0.3676], [24; 0; 0; 0.3868; 0.3868; 0.3868; 0; 43090; 0.3868], [25; 0; 0; 0.4055; 0.4055; 0.4055; 0; 43090; 0.4055]})

Lin_points = struct(
  V=[4 5 6 7 8 9 10 11 12 13 14 15 16 17 18 19 20 21 22 23 24 25],
  Torque=[5.084 7.941 11.42 15.52 20.23 25.51 31.34 43.53 43.53 43.53 43.53 43.53 43.53 43.53 43.53 43.53 43.53 43.53 43.53 43.53 43.53 43.53],
  Pitch=[0.001850049 0.001850049 0.001850049 0.001850049 0.001850049 0.001850049 0.001850049 0.001850049 0.06356489 0.1125912 0.1498191 0.1816888 0.2104867 0.2370157 0.2619739 0.2853613 0.3077015 0.3293436 0.3502876 0.3703589 0.389732 0.4085816],
  GSpeed=[46.68407 58.34985 69.98421 81.58716 93.12728 104.5836 115.9248 121.6844 121.6844 121.6844 121.6844 121.6844 121.6844 121.6844 121.6844 121.6844 121.6844 121.6844 121.6844 121.6844 121.6844 121.6844],
  RSpeed=[0.481292 0.6015103 0.7215191 0.8411091 0.9600707 1.078613 1.194852 1.254543 1.254543 1.254543 1.254543 1.254543 1.254543 1.254543 1.254543 1.254543 1.254543 1.254543 1.254543 1.254543 1.254543 1.254543],
  x_op={[0.04089; 0.006898; -0.0002003; 0.0001115; 2.874; 0.0005691; 0.7722; 0.9567; 1.153; 0.4645; -0.08802; -0.2871; 0.003351; -0.01636; -0.02975; -1.797e-5; 0.003571; -2.808e-7; 3.171e-6; 0.4813; 1.791e-6; -0.05546; 0.1083; -0.05252; 0.05736; -0.2114; 0.1538; 0.003753; -0.009248; 0.005485], [0.0727; 0.008966; -0.0001352; 0.0001723; 1.23; 0.0008882; 1.554; 1.201; 1.51; -0.1058; 0.4853; -0.2547; -0.02884; -0.0003276; -0.02987; 4.126e-5; 0.004068; 7.277e-7; 3.736e-6; 0.6016; 1.8e-6; -0.1077; -0.01748; 0.1245; 0.2554; -0.04929; -0.2064; 0.01028; -0.0003401; -0.009938], [0.1115; 0.01133; -5.464e-5; 0.0002462; 6.278; 0.001277; 2.178; 1.929; 1.795; -0.396; 0.2788; 0.2836; -0.0458; -0.01976; -0.01417; 0.0002858; 0.003988; 2.284e-7; 3.969e-6; 0.7215; 1.455e-6; 0.0562; -0.1593; 0.1016; 0.001532; 0.282; -0.2838; -0.002341; 0.01322; -0.01088], [0.1575; 0.01396; 3.502e-5; 0.000333; 5.178; 0.001735; 2.599; 2.777; 2.39; -0.1334; -0.1756; 0.5221; -0.04081; -0.04853; -0.01591; -5.253e-5; 0.002741; -1.241e-6; 2.118e-6; 0.8411; 8.469e-7; 0.1891; -0.1016; -0.0844; -0.3418; 0.3169; 0.02492; -0.01584; 0.01207; 0.00373], [0.2094; 0.01821; 0.0001422; 0.0004332; 4.073; 0.00226; 3.07; 3.449; 3.292; 0.3604; -0.3619; 0.265; -0.03076; -0.06426; -0.04077; -6.319e-5; -0.001387; 3.63e-6; -8.385e-7; 0.9601; -1.532e-6; 0.08499; 0.1253; -0.2149; -0.3488; -0.04797; 0.3968; -0.01298; -0.005592; 0.01863], [0.2677; 0.0265; 0.0002554; 0.0005496; 2.905; 0.002852; 3.857; 3.928; 4.217; 0.5448; -0.02291; -0.2059; -0.03886; -0.05915; -0.07364; 0.0002512; -0.005983; -6.958e-6; -6.027e-6; 1.078; -2.711e-6; -0.1735; 0.2179; -0.03967; 0.1192; -0.4706; 0.352; 0.00888; -0.02145; 0.01253], [0.3316; 0.03535; 0.000382; 0.0006767; 1.574; 0.003506; 4.921; 4.558; 4.824; 0.1226; 0.5186; -0.2713; -0.07504; -0.05171; -0.08624; -0.0002367; -0.001524; 9.822e-6; -1.975e-6; 1.195; 3.589e-7; -0.1909; -0.0564; 0.2469; 0.5376; -0.2686; -0.2689; 0.02411; -0.00803; -0.01626], [0.3905; 0.04241; 0.0005117; 0.0008439; 4.367; 0.004374; 5.226; 5.599; 5.449; 0.2829; -0.3211; 0.413; -0.07366; -0.1052; -0.07434; -0.0003129; -0.007228; 9.919e-7; -3.314e-5; 1.255; -0.0003449; 0.09979; 0.1718; -0.2915; -0.5307; 0.1054; 0.4408; -0.02224; -0.0003638; 0.02329], [0.334; 0.0458; 0.0004017; 0.0009343; 4.452; 0.004849; 4.36; 4.791; 4.474; 0.2624; -0.2839; 0.4654; -0.07023; -0.1036; -0.06603; -4.444e-5; -0.003499; 2.746e-6; 2.888e-5; 1.255; 0.000105; 0.2346; 0.08068; -0.3166; -0.551; 0.1509; 0.3927; -0.02681; 0.003663; 0.02522], [0.2859; 0.04689; 0.000304; 0.0009365; 4.45; 0.004869; 3.606; 4.069; 3.682; 0.2677; -0.2694; 0.4728; -0.0654; -0.1012; -0.0596; 7.933e-5; -0.003762; 6.44e-6; 4.005e-5; 1.255; 0.0001529; 0.2917; 0.05174; -0.3378; -0.5447; 0.152; 0.3856; -0.03062; 0.004018; 0.02547], [0.2552; 0.04808; 0.000241; 0.0009273; 4.435; 0.004821; 3.082; 3.569; 3.147; 0.274; -0.2635; 0.4699; -0.06288; -0.1007; -0.05659; 0.0003074; -0.004586; 8.709e-6; -1.878e-5; 1.255; -0.0002031; 0.3128; 0.03684; -0.3611; -0.5334; 0.1507; 0.3908; -0.03328; 0.003289; 0.02592], [0.2328; 0.04783; 0.000196; 0.000932; 4.43; 0.004845; 2.67; 3.17; 2.726; 0.2701; -0.2636; 0.4632; -0.06199; -0.1013; -0.05509; 0.0004457; -0.004649; 5.101e-6; -7.714e-6; 1.255; -0.0002664; 0.3333; 0.0332; -0.3666; -0.531; 0.1468; 0.3848; -0.03367; 0.00508; 0.02882], [0.2151; 0.04801; 0.0001608; 0.0009295; 4.426; 0.004827; 2.323; 2.831; 2.372; 0.2654; -0.2643; 0.4562; -0.06181; -0.1022; -0.0544; 0.0005993; -0.004991; 5.741e-6; -2.906e-6; 1.255; -0.0002336; 0.3453; 0.02624; -0.3723; -0.5244; 0.1473; 0.3836; -0.03451; 0.005761; 0.0301], [0.2008; 0.04732; 0.0001337; 0.0009243; 4.425; 0.00481; 2.022; 2.527; 2.065; 0.2594; -0.2661; 0.4488; -0.06227; -0.1036; -0.05426; 0.000619; -0.004545; 6.982e-6; -3.227e-6; 1.255; -0.0002245; 0.3494; 0.0254; -0.3745; -0.5198; 0.1463; 0.3802; -0.03588; 0.006171; 0.03068], [0.1887; 0.04672; 0.0001114; 0.0009177; 4.421; 0.004786; 1.748; 2.236; 1.792; 0.2532; -0.2698; 0.4399; -0.06335; -0.1055; -0.05481; 0.0008189; -0.005101; 1.159e-5; -6.164e-6; 1.255; -0.000145; 0.3407; 0.02431; -0.3655; -0.5172; 0.1427; 0.3759; -0.03745; 0.005794; 0.03068], [0.1787; 0.04612; 9.432e-5; 0.0009108; 4.419; 0.004767; 1.5; 1.976; 1.54; 0.2462; -0.274; 0.4302; -0.06486; -0.1074; -0.05604; 0.0009999; -0.005602; 1.309e-5; 1.464e-5; 1.255; 0.0001759; 0.3329; 0.01673; -0.3479; -0.5115; 0.1418; 0.3754; -0.03722; 0.006643; 0.03202], [0.1703; 0.04581; 8.085e-5; 0.0009054; 4.416; 0.004745; 1.275; 1.749; 1.306; 0.2392; -0.2778; 0.4203; -0.06635; -0.109; -0.05749; 0.001294; -0.006161; 1.193e-5; -8.613e-6; 1.255; -0.000364; 0.3366; 0.01044; -0.3368; -0.5056; 0.141; 0.3748; -0.03735; 0.006536; 0.03227], [0.1633; 0.04521; 7.1e-5; 0.0008968; 4.413; 0.004714; 1.075; 1.536; 1.097; 0.233; -0.2811; 0.4113; -0.06771; -0.1106; -0.05877; 0.001474; -0.006212; 1.946e-5; -1.195e-5; 1.255; -0.0002614; 0.3369; 0.004309; -0.3345; -0.5043; 0.1352; 0.3672; -0.03882; 0.005708; 0.03107], [0.1572; 0.04401; 6.488e-5; 0.0008855; 4.409; 0.004672; 0.8909; 1.317; 0.9074; 0.2278; -0.2859; 0.4019; -0.06922; -0.1127; -0.06009; 0.001235; -0.006261; 1.305e-5; -4.337e-5; 1.255; -5.597e-5; 0.3246; -0.002297; -0.3216; -0.4973; 0.1345; 0.3694; -0.03985; 0.005991; 0.03119], [0.1519; 0.04351; 6.061e-5; 0.0008806; 4.405; 0.004658; 0.7171; 1.098; 0.727; 0.2203; -0.2933; 0.3907; -0.07145; -0.1153; -0.06205; 0.001431; -0.006692; 2.258e-5; -3.054e-5; 1.255; -0.0003806; 0.3042; -0.00898; -0.2867; -0.494; 0.1321; 0.3688; -0.0392; 0.006818; 0.03242], [0.1473; 0.04275; 5.962e-5; 0.0008723; 4.402; 0.004621; 0.5503; 0.8864; 0.549; 0.2135; -0.3; 0.3801; -0.07391; -0.1177; -0.06434; 0.001485; -0.00643; 2.086e-5; -2.443e-5; 1.255; -2.175e-5; 0.2763; -0.02026; -0.2489; -0.4905; 0.1292; 0.369; -0.03916; 0.007091; 0.03325], [0.1432; 0.04207; 5.979e-5; 0.0008626; 4.399; 0.004585; 0.3912; 0.6882; 0.3762; 0.2059; -0.3068; 0.3691; -0.07661; -0.1199; -0.06693; 0.001644; -0.006546; 2.724e-5; -2.407e-5; 1.255; -0.0003437; 0.2528; -0.02808; -0.2135; -0.487; 0.1265; 0.3682; -0.03854; 0.007569; 0.03368]},
  y_op={[4; 0; 0; 224.1; 5.084; 0.8481; 0.9173; 1.064; 0.3631; -0.2079; -0.4306; 0.0001462; 0.006952; 1.955e-5; 1766; 1565; 1854; -3297; 1065; 2704; 1760; 1567; 1859; -3300; 1062; 2700; 739.5; 7318; -31.28; 121.9; -495.4; 4.596; 445.8; 0.106; 254.7; 237.7; 190.3; 4.596; 5.091], [5; 0; 0; 437.4; 7.941; 1.494; 1.273; 1.424; -0.3014; 0.33; -0.443; 0.0005672; 0.003415; 8.281e-5; 2684; 2467; 2374; 1448; -3290; 2578; 2687; 2461; 2379; 1443; -3294; 2574; 865.1; 12250; -58.98; 497.5; 163.4; 5.744; 557.2; 0.106; 160.6; 463.6; 244.7; 5.744; 7.945], [6; 0; 0; 754.8; 11.42; 2.046; 1.941; 1.814; -0.6676; 0.03305; 0.05523; 0.0008753; -0.001371; 0.0001241; 3450; 3612; 3267; 3949; -1407; -1483; 3457; 3610; 3264; 3943; -1413; -1489; 992.6; 18270; -92.64; 7.756; 535.2; 6.89; 668.3; 0.106; 89.76; 799.5; 310.9; 6.89; 11.42], [7; 0; 0; 1196; 15.52; 2.514; 2.674; 2.443; -0.4598; -0.5246; 0.2166; -0.0007585; -0.008016; -0.0001003; 4319; 4715; 4534; 2077; 2474; -3113; 4323; 4720; 4528; 2069; 2465; -3121; 1119; 25410; -137.4; -511.4; 260.6; 8.032; 779.1; 0.106; 26.77; 1266; 389.1; 8.032; 15.52], [8; 0; 0; 1778; 20.23; 3.075; 3.294; 3.268; -0.02945; -0.7942; -0.1526; 0.0005776; -0.009988; 7.629e-5; 5534; 5685; 5965; -1565; 4201; -763; 5531; 5693; 5963; -1576; 4191; -774.1; 1461; 33460; -208.9; -462.7; -375.7; 9.168; 889.3; 0.106; 323.5; 1883; 478; 9.168; 20.22], [9; 0; 0; 2519; 25.51; 3.878; 3.831; 4.073; 0.05377; -0.5182; -0.7368; -0.0004883; 0.001489; -6.4e-5; 7139; 6754; 7240; -2707; 1773; 3296; 7134; 6757; 7246; -2720; 1760; 3283; 2406; 42530; -268.9; 191.2; -624.3; 10.3; 998.7; 0.106; 256.6; 2668; 577.6; 10.3; 25.51], [10; 0; 0; 3430; 31.34; 4.824; 4.556; 4.65; -0.5001; -0.06085; -0.8784; 9.981e-5; 0.01375; 3.562e-5; 8791; 8343; 8231; 1010; -2189; 4081; 8793; 8338; 8239; 993.9; -2204; 4066; 3411; 52440; -384.1; 703.6; 101.9; 11.41; 1107; 0.106; 180.4; 3635; 687.1; 11.41; 31.36], [11; 0; 0; 5002; 43.53; 5.156; 5.391; 5.398; -0.3796; -1.027; -0.2789; 0.001229; 0.008808; 0.0001384; 9376; 9677; 9969; -77.62; 4764; -1067; 9376; 9686; 9967; -94.97; 4746; -1085; 3976; 61540; -440.5; -618.9; -319.4; 11.98; 1162; 0.106; 340.5; 4758; 787; 11.98; 39.1], [12; 0; 0; 5000; 43.53; 4.271; 4.534; 4.434; -0.5565; -1.171; -0.3795; 0.0007258; 0.002988; -2.513e-5; 8059; 8327; 8585; 365.9; 4829; -1182; 8066; 8617; 8493; -146.7; 4291; -1725; 4216; 52780; -502.9; -586.3; -279.3; 11.98; 1162; 3.642; 345.4; 5279; 690.2; 11.98; 43.38], [13; 0; 0; 5001; 43.53; 3.512; 3.775; 3.648; -0.5842; -1.21; -0.4044; 0.0002525; 0.005222; -3.038e-5; 6934; 7120; 7438; 378.4; 4823; -1175; 6932; 7617; 7259; -403; 3993; -2004; 4389; 45300; -566.4; -544.7; -337; 11.98; 1162; 6.451; 345.2; 5302; 607.7; 11.98; 43.56], [14; 0; 0; 5001; 43.53; 2.988; 3.248; 3.117; -0.5678; -1.21; -0.3988; 0.001759; 0.0118; 0.0003745; 6192; 6303; 6694; 322; 4806; -1149; 6170; 6950; 6447; -605.8; 3811; -2135; 4616; 40550; -627.3; -511.5; -406.9; 11.98; 1162; 8.584; 344.4; 5246; 555.7; 11.98; 43.11], [15; 0; 0; 5002; 43.53; 2.574; 2.826; 2.701; -0.5429; -1.193; -0.3785; 0.001414; 0.01119; 0.0001454; 5620; 5661; 6129; 317.6; 4797; -1123; 5585; 6435; 5825; -703.2; 3695; -2212; 4551; 37060; -700.2; -483.4; -478.2; 11.98; 1162; 10.41; 344.1; 5272; 517.3; 11.98; 43.32], [16; 0; 0; 5002; 43.53; 2.228; 2.469; 2.352; -0.5077; -1.164; -0.3467; 0.002056; 0.01208; 0.0002782; 5155; 5128; 5670; 307; 4773; -1109; 5106; 6011; 5313; -776.7; 3596; -2269; 4590; 34320; -771; -454.5; -547.6; 11.98; 1162; 12.06; 343.9; 5253; 487.1; 11.98; 43.16], [17; 0; 0; 5002; 43.53; 1.929; 2.151; 2.053; -0.4665; -1.124; -0.3082; 0.002318; 0.009727; 0.0003231; 4765; 4659; 5286; 302.9; 4742; -1096; 4703; 5642; 4881; -824.5; 3516; -2307; 4494; 32090; -852; -420.1; -625.3; 11.98; 1162; 13.58; 343.8; 5234; 462.5; 11.98; 43.01], [18; 0; 0; 5002; 43.53; 1.659; 1.849; 1.787; -0.4173; -1.071; -0.2648; 0.00261; 0.008033; 0.0004253; 4424; 4225; 4955; 292.9; 4705; -1077; 4349; 5299; 4507; -862.7; 3451; -2323; 4420; 30210; -948.7; -378.9; -719.1; 11.98; 1162; 15.01; 343.6; 5209; 441.6; 11.98; 42.8], [19; 0; 0; 5000; 43.53; 1.416; 1.581; 1.543; -0.3635; -1.014; -0.2151; 0.002281; 0.005615; 0.0003111; 4125; 3840; 4662; 286.8; 4669; -1057; 4039; 4999; 4176; -885.9; 3399; -2326; 4348; 28650; -1037; -339; -802.7; 11.98; 1162; 16.35; 343.4; 5191; 424.1; 11.98; 42.65], [20; 0; 0; 5002; 43.53; 1.199; 1.348; 1.319; -0.3074; -0.9578; -0.1606; 0.002285; 0.006679; 0.0003226; 3862; 3505; 4398; 279.4; 4631; -1041; 3765; 4743; 3876; -903.5; 3352; -2325; 4311; 27340; -1105; -302.1; -868.1; 11.98; 1162; 17.63; 343.3; 5163; 409.3; 11.98; 42.42], [21; 0; 0; 5002; 43.53; 1.007; 1.131; 1.121; -0.2511; -0.8962; -0.1054; 0.002008; 0.004899; 0.0002808; 3633; 3194; 4168; 273.6; 4586; -1026; 3526; 4506; 3612; -916; 3307; -2318; 4245; 26230; -1181; -259.6; -940.3; 11.98; 1162; 18.87; 343.1; 5130; 396.7; 11.98; 42.15], [22; 0; 0; 5001; 43.53; 0.8337; 0.9134; 0.9442; -0.1925; -0.8239; -0.0505; 0.001068; 0.0001196; 2.664e-5; 3431; 2885; 3963; 261.8; 4533; -1004; 3312; 4265; 3378; -931.2; 3268; -2303; 4094; 25260; -1284; -202.2; -1035; 11.98; 1162; 20.07; 342.9; 5085; 385.3; 11.98; 41.79], [23; 0; 0; 5002; 43.53; 0.6704; 0.6967; 0.7763; -0.1329; -0.744; 0.006683; 0.001067; -0.0002328; 0.0001723; 3248; 2582; 3774; 262.7; 4480; -975.7; 3123; 4028; 3165; -930.8; 3242; -2276; 4024; 24410; -1397; -136.4; -1139; 11.98; 1162; 21.22; 342.7; 5068; 375.3; 11.98; 41.64], [24; 0; 0; 5001; 43.53; 0.5161; 0.4919; 0.613; -0.06932; -0.659; 0.07041; 0.0001116; -0.001978; -3.658e-5; 3080; 2294; 3595; 261.9; 4420; -953.9; 2949; 3802; 2963; -928.2; 3216; -2248; 3929; 23670; -1504; -67.63; -1236; 11.98; 1162; 22.33; 342.5; 5030; 366.2; 11.98; 41.33], [25; 0; 0; 5002; 43.53; 0.3705; 0.3024; 0.4566; -0.004079; -0.5729; 0.1378; 0.0003997; -0.003597; 3.575e-5; 2926; 2028; 3427; 264.2; 4356; -935; 2790; 3592; 2774; -920.3; 3192; -2220; 3852; 23010; -1603; -1.745; -1324; 11.98; 1162; 23.41; 342.3; 4988; 358.4; 11.98; 40.99]},
  u_op={[4; 0; 0; 0.00185; 0.00185; 0.00185; 0; 5084; 0.00185], [5; 0; 0; 0.00185; 0.00185; 0.00185; 0; 7941; 0.00185], [6; 0; 0; 0.00185; 0.00185; 0.00185; 0; 11420; 0.00185], [7; 0; 0; 0.00185; 0.00185; 0.00185; 0; 15520; 0.00185], [8; 0; 0; 0.00185; 0.00185; 0.00185; 0; 20230; 0.00185], [9; 0; 0; 0.00185; 0.00185; 0.00185; 0; 25510; 0.00185], [10; 0; 0; 0.00185; 0.00185; 0.00185; 0; 31340; 0.00185], [11; 0; 0; 0.00185; 0.00185; 0.00185; 0; 43530; 0.00185], [12; 0; 0; 0.06357; 0.06357; 0.06357; 0; 43530; 0.06357], [13; 0; 0; 0.1126; 0.1126; 0.1126; 0; 43530; 0.1126], [14; 0; 0; 0.1498; 0.1498; 0.1498; 0; 43530; 0.1498], [15; 0; 0; 0.1817; 0.1817; 0.1817; 0; 43530; 0.1817], [16; 0; 0; 0.2104; 0.2104; 0.2104; 0; 43530; 0.2104], [17; 0; 0; 0.237; 0.237; 0.237; 0; 43530; 0.237], [18; 0; 0; 0.2619; 0.2619; 0.2619; 0; 43530; 0.2619], [19; 0; 0; 0.2854; 0.2854; 0.2854; 0; 43530; 0.2854], [20; 0; 0; 0.3077; 0.3077; 0.3077; 0; 43530; 0.3077], [21; 0; 0; 0.3293; 0.3293; 0.3293; 0; 43530; 0.3293], [22; 0; 0; 0.3502; 0.3502; 0.3502; 0; 43530; 0.3502], [23; 0; 0; 0.3704; 0.3704; 0.3704; 0; 43530; 0.3704], [24; 0; 0; 0.3898; 0.3898; 0.3898; 0; 43530; 0.3898], [25; 0; 0; 0.4086; 0.4086; 0.4086; 0; 43530; 0.4086]})