% Simulink data dictionary DD_Mdl1.sldd

slBus1 = Simulink.Bus()
  wind_mpers: double
  GenSpd_radpers: double
  RotSpd_radpers: double
  ydotdot_mpers2: double
  xdotdot_mpers2: double
  zetadotdot_mpers2: double
  ThetaS_rad: double
  GenPwr_kW: double
  GenTq_Nm: double
  Pitch_rad: double

slBus2 = Simulink.Bus()
  RefBlPitch1: double
  RefBlPitch2: double
  RefBlPitch3: double
  RefGenTq: double

beta = [0; 0.001745329; 0.003490659; 0.005235988; 0.006981317; 0.008726646; 0.01047198; 0.0122173; 0.01396263; 0.01570796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 0.4363323]

Ce = [17786.98 0 0 0 0
 0 1246331 0 0 0
 0 0 17128.2 0 0
 0 0 0 6215000 -6215000
 0 0 0 -6215000 6215000]

Cq = [0 0 0 0 0 0 0 0 0 0 0.005455993 0.005630566 0.005817641 0.00601599 0.006243612 0.006586365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
 0 0 0 0 0 0 0 0 0 0 0.005525813 0.005702732 0.005892449 0.006093771 0.006326961 0.00668177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
 0 0 0 0 0 0 0 0 0 0 0.005595304 0.005774886 0.005966923 0.00617156 0.006409965 0.006776822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
 0 0 0 0 0 0 0 0 0 0 0.005664533 0.005846586 0.006041334 0.006249359 0.006493239 0.006871986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
 0 0 0 0 0 0 0 0 0 0 0.005733716 0.00591818 0.006115751 0.006327165 0.006577102 0.006967089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
 0 0 0 0 0 0 0 0 0 0 0.005802815 0.005989521 0.006190175 0.006404624 0.006661383 0.007062018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
 0 0 0 0 0 0 0 0 0 0 0.005871923 0.00606081 0.006264522 0.006481802 0.006745966 0.007157457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
 0 0 0 0 0 0 0 0 0 0 0.005940995 0.006132543 0.006338596 0.006559043 0.006830197 0.007255055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
 0 0 0 0 0 0 0 0 0 0 0.006010072 0.00620385 0.006412594 0.006636455 0.006915282 0.007352912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
 0 0 0 0 0 0 0 0 0 0 0.006078972 0.006275166 0.006486356 0.006713469 0.00700022 0.007451203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 ]

Ct = [0 0 0 0 0 0 0 0 0 0 0.08296217 0.0859444 0.08898923 0.09218252 0.09547205 0.099147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
 0 0 0 0 0 0 0 0 0 0 0.08292507 0.0858965 0.08893239 0.09211563 0.09539839 0.09907465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
 0 0 0 0 0 0 0 0 0 0 0.08288701 0.08584788 0.08887387 0.09204868 0.09532177 0.09900196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
 0 0 0 0 0 0 0 0 0 0 0.08284852 0.08579822 0.08881448 0.09198163 0.09528317 0.09892982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
 0 0 0 0 0 0 0 0 0 0 0.08280999 0.0857479 0.08875488 0.09191438 0.09520931 0.0988561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
 0 0 0 0 0 0 0 0 0 0 0.08277126 0.08569671 0.08869521 0.09184644 0.09515612 0.09878253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
 0 0 0 0 0 0 0 0 0 0 0.08273247 0.08564468 0.08863495 0.0917777 0.09508159 0.09871075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
 0 0 0 0 0 0 0 0 0 0 0.08269272 0.0855223 0.08857483 0.09170892 0.09500664 0.09866092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
 0 0 0 0 0 0 0 0 0 0 0.08265194 0.08547015 0.08851378 0.09163989 0.09495906 0.09859092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
 0 0 0 0 0 0 0 0 0 0 0.08260986 0.08541792 0.08845225 0.09156891 0.09488377 0.09852131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 ]

K5 = [1810494 0 0 0 -0
 0 5.734629e+08 0 0 -0
 0 0 1678867 0 -0
 0 0 0 867637000 -867637000
 0 0 0 -867637000 867637000]

lambda = [0; 0.1; 0.2; 0.3; 0.4; 0.5; 0.6; 0.7; 0.8; 0.9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 19.9]

M = [450170 628661.25 0 0 0
 628661.25 29704244.0625 0 0 0
 0 0 436865 0 0
 0 0 0 35443926 0
 0 0 0 0 5025497.444]

Q = [1 0 0; 47.25 0 0; 0 0.007407407 -0.7185185; 0 1 0; 0 0 -97]
rho = 1.225

wecs = struct(
  N=3,
  Ng=97,
  mh=56780,
  mbl=17740,
  mb=4435,
  mn=240000,
  mtower=347460,
  mr=110000,
  mt=436865,
  mtb=450170,
  H=90,
  Jg=534.116,
  Jr=35443926,
  Js=40469423.444,
  wnb=4.393831,
  wnt=2.035752,
  wntsw=1.960354,
  zetat=0.01,
  zetab=0.00477465,
  Kt=1810494,
  Bt=17786.98,
  Ktsw=1678867,
  Btsw=17128.2,
  Kb=85621.02,
  Bb=186.0838,
  Ks=867637000,
  Bs=6215000,
  Rr=63,
  rb=47.25,
  etag=0.944)